# Grasshopper definition FilamentDesignSystem_v1.gh (Grasshopper 1.0.7)
# plug-ins: Human UI, Clipper

launchwin = LaunchWindow(Show=Toggle(True), Name="Filament design system", Width=450, Height=600, ChildStatus=1, EnableHorizScroll=False)
panel = Panel("""<Grid>
<Label Content="Material" Height="56" Margin="10,0,0,0" HorizontalAlignment="Left" Name="BaseLabel" VerticalAlignment="Top" />
<TextBox Width="200" Height="150" Margin="10,26,0,0"
    AcceptsReturn="True"
    TextWrapping="Wrap"
    VerticalContentAlignment="Top"/>
</Grid>""")
panel_2 = Panel("""<Grid>
<Label Content="Length" Height="56" HorizontalAlignment="Left" Name="BaseLabel" VerticalAlignment="Top" />
<TextBox Width="200" Height="150" Margin="0,26,0,0"
    AcceptsReturn="True" TextWrapping="Wrap"
    VerticalContentAlignment="Top"/>
</Grid>""")
textbox = CreateTextBox(Label="   X", DefaultText="125", UpdateButton=False, showLabel=True)
textbox_2 = CreateTextBox(Label="     Y", DefaultText="125", UpdateButton=False, showLabel=True)
label = CreateLabel(LabelText="Center of spiral", LabelSize=12, Justification=0)
textbox_3 = CreateTextBox(Label="Turn", DefaultText="3", UpdateButton=False, showLabel=True)
button = CreateButton(ButtonName="Generate Gcode", ButtonStyle=0)
button_2 = CreateButton(ButtonName="Material setting", ButtonStyle=0)
label_2 = CreateLabel(LabelText="Length", LabelSize=12, Justification=0)
label_3 = CreateLabel(LabelText="Turn count", LabelSize=12, Justification=0)
textbox_4 = CreateTextBox(Label="Inner", DefaultText="70", UpdateButton=False, showLabel=True)
textbox_5 = CreateTextBox(Label="Outer", DefaultText="110", UpdateButton=False, showLabel=True)
label_4 = CreateLabel(LabelText="Radius", LabelSize=12, Justification=0)
merge = Merge(Data1=label_3, Data2=textbox_3)
merge_2 = Merge(Data1=label, Data2=textbox, Data3=textbox_2)
merge_3 = Merge(Data1=label_4, Data2=textbox_4, Data3=textbox_5)
merge_4 = Merge(Data1=merge_2, Data2=merge, Data3=merge_3)
label_5 = CreateLabel(LabelText="Count", LabelSize=12, Justification=0)
label_6 = CreateLabel(LabelText="Count", LabelSize=12, Justification=0)
stack = CreateStack(UIElements=merge, Horizontal=True)
separator = CreateSeparator(Thickness=0.5, Horizontal=True, Color=RGB(0, 0, 0), Width=500, Height=30)
stack_2 = CreateStack(UIElements=merge_2, Horizontal=True)
adjustpos = AdjustElementPositioning(ElementsToAdjust=[label, label_3, label_4], AbsolutePositioning=False, Width=100)
stack_3 = CreateStack(UIElements=merge_3, Horizontal=True)
values = ValueListener(Elements=button, SomeProperty=True)  # -> Values, Indices
separator_2 = CreateSeparator(Thickness=0.5, Horizontal=True, Color=RGB(0, 0, 0), Width=500, Height=30)
savestates = SaveElementStates(
    Elements=merge_4,
    SaveState=values.Values,
    StateName="State",
    ClearSavedStates=False,
    stateSetChunk_State0_stateName="State",
    stateSetChunk_State0_stateItem0_ElementIndex=0,
    stateSetChunk_State0_stateItem0_ElementValue="Center of spiral",
    stateSetChunk_State0_stateItem0_ElementValueType="System.String",
    stateSetChunk_State0_stateItem1_ElementIndex=0,
    stateSetChunk_State0_stateItem1_ElementValue="125",
    stateSetChunk_State0_stateItem1_ElementValueType="System.String",
    stateSetChunk_State0_stateItem2_ElementIndex=0,
    stateSetChunk_State0_stateItem2_ElementValue="125",
    stateSetChunk_State0_stateItem2_ElementValueType="System.String",
    stateSetChunk_State0_stateItem3_ElementIndex=0,
    stateSetChunk_State0_stateItem3_ElementValue="Turn count",
    stateSetChunk_State0_stateItem3_ElementValueType="System.String",
    stateSetChunk_State0_stateItem4_ElementIndex=0,
    stateSetChunk_State0_stateItem4_ElementValue="3",
    stateSetChunk_State0_stateItem4_ElementValueType="System.String",
    stateSetChunk_State0_stateItem5_ElementIndex=0,
    stateSetChunk_State0_stateItem5_ElementValue="Radius",
    stateSetChunk_State0_stateItem5_ElementValueType="System.String",
    stateSetChunk_State0_stateItem6_ElementIndex=0,
    stateSetChunk_State0_stateItem6_ElementValue="70",
    stateSetChunk_State0_stateItem6_ElementValueType="System.String",
    stateSetChunk_State0_stateItem7_ElementIndex=0,
    stateSetChunk_State0_stateItem7_ElementValue="110",
    stateSetChunk_State0_stateItem7_ElementValueType="System.String")  # -> SavedStates, SavedStateNames
adjustpos_2 = AdjustElementPositioning(ElementsToAdjust=[textbox_4, textbox_5, textbox, textbox_2, textbox_3], AbsolutePositioning=False, Width=80)
xaml = CreateObjectsFromXAML(XAML=panel)
xaml_2 = CreateObjectsFromXAML(XAML=panel_2)
merge_5 = Merge(Data1=stack_2, Data2=stack, Data3=stack_3, Data4=label_2)
data = Data(merge_5)
Z = UnitZ(Factor=1)
X = UnitX(Factor=1)
values_2 = ValueListener(Elements=textbox_5, SomeProperty=True)  # -> Values, Indices
values_3 = ValueListener(Elements=textbox_4, SomeProperty=True)  # -> Values, Indices
values_4 = ValueListener(Elements=textbox_3, SomeProperty=True)  # -> Values, Indices
merge_6 = Merge(Data1=xaml_2, Data2=xaml)  # -> flatten(Result)
stack_4 = CreateStack(UIElements=[label_6, label_5], Horizontal=True)  # -> flatten(Stack)
adjustpos_3 = AdjustElementPositioning(ElementsToAdjust=label_6, AbsolutePositioning=False, Width=210)
number_slider = Slider(40, range=0..400)
values_5 = ValueListener(Elements=textbox_2, SomeProperty=True)  # -> Values, Indices
values_6 = ValueListener(Elements=textbox, SomeProperty=True)  # -> Values, Indices
pt = ConstructPoint(XCoordinate=values_6.Values, YCoordinate=values_5.Values, ZCoordinate=0)
stack_5 = CreateStack(UIElements=merge_6, Horizontal=True)
division = Division(A=Slider(1.75, range=0..2), B=2)
values_7 = ValueListener(Elements=button_2, SomeProperty=True)  # -> Values, Indices
spiral = Spiral(axisstart=pt, axisdir=Z, radiuspoint=X, turncount=values_4.Values, radius0=values_3.Values, radius1=values_2.Values)
values_8 = ValueListener(Elements=xaml, SomeProperty=True)  # -> Values, Indices
c_script = CSharpScript(x=values_7.Values)  # -> out, A; inputs x: Boolean, y: String
# ---------- c_script: C# ----------
    if(x == true){
      stat = !stat;
    }

    A = stat;
# ---------- c_script: C# additional code ----------
    bool stat = false;
# ---------- end c_script ----------
number_slider_2 = Slider(300, range=0..1000)
number_slider_3 = Slider(0.2, range=0..1)
series = Series(Start=Slider(50, range=0..50), Step=0, Count=number_slider)
values_9 = ValueListener(Elements=button, SomeProperty=True)  # -> Values, Indices
values_10 = ValueListener(Elements=xaml_2, SomeProperty=True)  # -> Values, Indices
series_2 = Series(Start=0, Step=1, Count=number_slider)
division_2 = Division(A=1, B=division)
filter = StreamFilter(Gate=values_9.Values, Stream1=spiral)
mod = Modulus(A=series_2, B=Slider(3, range=0..10))
split = SplitTree(Data=values_8.Values, Masks=flatten("{1}"))  # -> graft(Positive), Negative
split_2 = SplitTree(Data=values_10.Values, Masks=flatten("{1}"))  # -> Positive, Negative
ma = MassAddition(Input=series)  # -> Result, PartialResults
neg = Negative(Value=number_slider_2)
len = Length(Curve=spiral)
round = Round(Number=len)  # -> Nearest, Floor, Ceiling
concat = Concatenate(FragmentA="Length of spiral : ", FragmentB=round.Ceiling)
setlabel = SetLabelContents(LabelToModify=label_2, NewLabelContents=concat)
series_3 = Series(Start="0.001", Step=Slider(0.172, range=0..0.4), Count=Slider(50, range=0..50))
crv = Curve(reparameterize(spiral))
xy = XYPlane(Origin=Point(0, 0, 0))
dom = ConstructDomain(DomainStart=neg, DomainEnd=number_slider_2)
pframe = PerpFrame(Curve=crv, Parameter="0")
panel_3 = Panel(len)
c_script_2 = CSharpScript(x=split.Positive)  # -> out, A; inputs x: String
# ---------- c_script_2: C# ----------
    x = x.TrimEnd();
    string[] str = x.Split('\n');


    int[] output = new int[str.Length];

    for(int i = 0; i < output.Length; i++){
      output[i] = int.Parse(str[i]);
    }


    A = output;
# ---------- end c_script_2 ----------
data_2 = Data(c_script_2.A)
lng = ListLength(List=c_script_2.A)
concat_2 = Concatenate(FragmentA="Count : ", FragmentB=lng)
setlabel_2 = SetLabelContents(LabelToModify=label_5, NewLabelContents=concat_2)
panel_4 = Panel(split_2.Positive)
number_slider_4 = Slider(1, range=0..4)
Z_2 = UnitZ(Factor=series_3)
c_script_3 = CSharpScript(x=split_2.Positive)  # -> out, A; inputs x: String
# ---------- c_script_3: C# ----------
    x = x.TrimEnd();
    string[] str = x.Split('\n');


    double[] output = new double[str.Length];

    for(int i = 0; i < output.Length; i++){
      output[i] = Double.Parse(str[i]);
    }


    A = output;
# ---------- end c_script_3 ----------
data_3 = Data(c_script_3.A)
number_slider_5 = Slider(2.5, range=0..10)
rectangle = Rectangle(Plane=xy, XSize=dom, YSize=dom, Radius=0)  # -> Rectangle, Length
hexgrid = Hexagonal(Plane=pframe, Size=division, ExtentX=1, ExtentY=1)  # -> Cells, Points
ma_2 = MassAddition(Input=c_script_3.A)  # -> Result, PartialResults
sort = SortList(Keys=c_script_2.A)  # -> Keys, ValuesA
ma_3 = MassAddition(Input=data_3)  # -> Result, PartialResults
ma_4 = MassAddition(Input=data_3)  # -> Result, PartialResults
lng_2 = ListLength(List=c_script_3.A)
panel_5 = Panel(split.Positive)
round_2 = Round(Number=ma_2.Result)  # -> Nearest, Floor, Ceiling
Z_3 = UnitZ(Factor=division)
dcon = DeleteConsecutive(Set=sort.Keys, Wrap=True)  # -> Set, Count
move = Move(Geometry=rectangle.Rectangle, Motion=Z_2)  # -> Geometry, Transform
scale_nu = ScaleNU(Geometry=hexgrid.Cells, Plane=pframe, ScaleX=1, ScaleY=division_2, ScaleZ=1)  # -> Geometry, Transform
neg_2 = Negative(Value=number_slider_5)
neg_3 = Negative(Value=number_slider_4)
xy_2 = XYPlane(Origin=Z_2)
panel_6 = Panel(ma_3.Result)
eval = EvaluateLength(Curve=crv, Length=ma_3.PartialResults, Normalized=False)  # -> Point, Tangent, Parameter
c_script_4 = CSharpScript(Len=ma_4.PartialResults, ColorNum=data_2)  # -> out, A; inputs Len: list of Double, ColorNum: list of Int32
# ---------- c_script_4: C# ----------
    if(ColorNum.Count < 1){
      return;
    }

    List<bool> slope = new List<bool>();
    for(int i = 1; i < ColorNum.Count; i++){
      if(ColorNum[i - 1] < ColorNum[i]){
        slope.Add(true);
      }else{
        slope.Add(false);
      }
    }
    
    if(ColorNum[ColorNum.Count - 1] == 0){
      slope.Add(true);
    }else{
      slope.Add(false);  
    }
    A = slope;
# ---------- end c_script_4 ----------
concat_3 = Concatenate(FragmentA="Count : ", FragmentB=lng_2, FragmentC=" -  Length : ", FragmentD=round_2.Ceiling, FragmentE="mm")
dom_2 = ConstructDomain(DomainStart=neg_2, DomainEnd=number_slider_5)
dom_3 = ConstructDomain(DomainStart=neg_3, DomainEnd=number_slider_4)
lng_3 = ListLength(List=dcon.Set)
swp1 = Sweep1(Rail=crv, Sections=scale_nu.Geometry, Miter=1)
setlabel_3 = SetLabelContents(LabelToModify=label_6, NewLabelContents=concat_3)
Z_4 = UnitZ(Factor=1)
pframe_2 = PerpFrame(Curve=crv, Parameter=eval.Parameter)
movetoplane = MoveToPlane(Geometry=swp1, Plane=PlaneXY(0, 0, 0), Above=True, Below=True)  # -> Geometry, Transform
dup = DuplicateData(Data="0", Number=lng_3, Order=True)
align = AlignPlane(Plane=pframe_2, Direction=Z_4)  # -> Plane, Angle
rectangle_2 = Rectangle(Plane=align.Plane, XSize=dom_2, YSize=dom_3, Radius=0)  # -> Rectangle, Length
move_2 = Move(Geometry=align.Plane, Motion=Z_3)  # -> Geometry, Transform
number_slider_6 = Slider(10, range=0..10)
explode = Explode(Curve=rectangle_2.Rectangle, Recursive=True)  # -> simplify(Segments), Vertices
dispatch = Dispatch(List=move_2.Geometry, DispatchPattern=c_script_4.A)  # -> ListA, ListB
contour = ContourEx(Shape=movetoplane.Geometry, Plane=simplify(move.Geometry), Offsets="0")  # -> simplify(Contours)
deplane = DeconstructPlane(Plane=dispatch.ListA)  # -> Origin, XAxis, YAxis, ZAxis
deplane_2 = DeconstructPlane(Plane=dispatch.ListB)  # -> Origin, XAxis, YAxis, ZAxis
item = ListItem(List=explode.Segments, Index=2, Wrap=True)
item_2 = ListItem(List=explode.Segments, Index=0, Wrap=True)
panel_7 = Panel("""0
2""")
pi = Pi(Factor=Slider(0.27, range=0..0.5))
pi_2 = Pi(Factor=2)
clean = CleanTree(RemoveNulls=True, RemoveInvalid=True, RemoveEmpty=True, Tree=contour)
flip = FlipCurve(Curve=item)  # -> Curve, Flag
pi_3 = Pi(Factor=1)
cull_i = CullIndex(List=explode.Segments, Indices=panel_7, Wrap=True)  # -> simplify(List)
cap = CapHoles(Brep=movetoplane.Geometry)
neg_4 = Negative(Value=pi)
dom_4 = ConstructDomain(DomainStart=0, DomainEnd=pi_2)
divide = DivideCurve(Curve=item_2, Count=number_slider_6, Kinks=False)  # -> simplify(Points), Tangents, Parameters
divide_2 = DivideCurve(Curve=flip.Curve, Count=number_slider_6, Kinks=False)  # -> simplify(Points), Tangents, Parameters
item_3 = ListItem(List=clean, Index=0, Wrap=True)
item_4 = ListItem(List=clean, Index=1, Wrap=True)
panel_8 = Panel("""PLA A
PLA B
ABS
TPU
SMP
PVA
-
-""")
panel_9 = Panel("""50
50
100
50
50
70
0
0""")
panel_10 = Panel("""1200
1200
800
600
1200
1200
0
0""")
panel_11 = Panel("""200
200
230
210
210
200
0
0""")
panel_12 = Panel("""100
100
100
200
100
100
0
0""")
range = Range(Domain=dom_4, Steps=number_slider_6)
flip_2 = FlipCurve(Curve=item_4)  # -> Curve, Flag
vec = Vector(align.Plane)
series_4 = Series(Start=0, Step=1, Count="8")
dup_2 = DuplicateData(Number="8", Order=True)
weave = Weave(Pattern=graft(c_script_4.A), Stream0="1", Stream1="-1", NullGaps=False)  # -> flatten(Weave)
number_slider_7 = Slider(6, range=0..10)
panel_13 = Panel("     Name                   Nozzle [deg]      Bed [deg]          Speed [mm/min] Flow [%]")
button_3 = CreateButton(ButtonName="Save", ButtonStyle=0)
sin = Sine(Value=range)
merge_7 = Merge(Data1=item_3, Data2=flip_2.Curve)
rectangle_3 = Rectangle(Plane=align.Plane, XSize=Domain(-1, 1), YSize=Domain(-2, 2), Radius=0)  # -> Rectangle, Length
multiplication = Multiplication(A=sin, B=Slider(0.5, range=0..1))
launchwin_2 = LaunchWindow(Show=c_script.A, Name="Material setting", Width=600, Height=400, ChildStatus=0, EnableHorizScroll=False)
multiplication_2 = Multiplication(A=weave, B=number_slider_7)
label_7 = CreateLabel(LabelText=panel_13, LabelSize=12, Justification=0)
label_8 = CreateLabel(LabelText=series_4, LabelSize=12, Justification=0)
textbox_6 = CreateTextBox(Label=series_4, DefaultText=panel_8, UpdateButton=False, showLabel=True)
textbox_7 = CreateTextBox(Label=dup_2, DefaultText=panel_10, UpdateButton=False, showLabel=True)
textbox_8 = CreateTextBox(Label=dup_2, DefaultText=panel_9, UpdateButton=False, showLabel=True)
textbox_9 = CreateTextBox(Label=dup_2, DefaultText=panel_11, UpdateButton=False, showLabel=True)
amp = Amplitude(Vector=vec, Amplitude=graft(multiplication))  # -> simplify(Vector)
textbox_10 = CreateTextBox(Label=dup_2, DefaultText=panel_12, UpdateButton=False, showLabel=True)
vec_2 = Vector(align.Plane)
move_3 = Move(Geometry=rectangle_3.Rectangle, Motion=Z_3)  # -> Geometry, Transform
values_11 = ValueListener(Elements=button_3, SomeProperty=True)  # -> Values, Indices
division_3 = Division(A=number_slider_7, B=multiplication_2)
winstat = WindowStatus(Window=launchwin_2)
multiplication_3 = Multiplication(A=vec_2, B=number_slider_7)
merge_8 = Merge(Data1=graft(textbox_6), Data2=graft(textbox_9), Data3=graft(textbox_8), Data4=graft(textbox_7), Data5=graft(textbox_10))
flip_3 = FlipMatrix(Data=amp)
division_4 = Division(A=number_slider_7, B=-2)
extr = Extrude(Base=move_3.Geometry, Direction=multiplication_3)
panel_14 = Panel(winstat)
flatten = FlattenTree(Tree=merge_8, Path="{0}")
values_12 = ValueListener(Elements=textbox_8, SomeProperty=True)  # -> Values, Indices
values_13 = ValueListener(Elements=textbox_9, SomeProperty=True)  # -> Values, Indices
values_14 = ValueListener(Elements=textbox_7, SomeProperty=True)  # -> Values, Indices
multiplication_4 = Multiplication(A=vec_2, B=division_4)
values_15 = ValueListener(Elements=textbox_6, SomeProperty=True)  # -> Values, Indices
values_16 = ValueListener(Elements=textbox_10, SomeProperty=True)  # -> Values, Indices
stack_6 = CreateStack(UIElements=merge_8, Horizontal=True)
savestates_2 = SaveElementStates(
    Elements=flatten,
    SaveState=values_11.Values,
    StateName="State",
    ClearSavedStates=False,
    stateSetChunk_State0_stateName="State",
    stateSetChunk_State0_stateItem0_ElementIndex=0,
    stateSetChunk_State0_stateItem0_ElementValue="PLA A",
    stateSetChunk_State0_stateItem0_ElementValueType="System.String",
    stateSetChunk_State0_stateItem1_ElementIndex=0,
    stateSetChunk_State0_stateItem1_ElementValue="200",
    stateSetChunk_State0_stateItem1_ElementValueType="System.String",
    stateSetChunk_State0_stateItem2_ElementIndex=0,
    stateSetChunk_State0_stateItem2_ElementValue="50",
    stateSetChunk_State0_stateItem2_ElementValueType="System.String",
    stateSetChunk_State0_stateItem3_ElementIndex=0,
    stateSetChunk_State0_stateItem3_ElementValue="1200",
    stateSetChunk_State0_stateItem3_ElementValueType="System.String",
    stateSetChunk_State0_stateItem4_ElementIndex=0,
    stateSetChunk_State0_stateItem4_ElementValue="100",
    stateSetChunk_State0_stateItem4_ElementValueType="System.String",
    stateSetChunk_State0_stateItem5_ElementIndex=1,
    stateSetChunk_State0_stateItem5_ElementValue="PLA B",
    stateSetChunk_State0_stateItem5_ElementValueType="System.String",
    stateSetChunk_State0_stateItem6_ElementIndex=1,
    stateSetChunk_State0_stateItem6_ElementValue="200",
    stateSetChunk_State0_stateItem6_ElementValueType="System.String",
    stateSetChunk_State0_stateItem7_ElementIndex=1,
    stateSetChunk_State0_stateItem7_ElementValue="50",
    stateSetChunk_State0_stateItem7_ElementValueType="System.String",
    stateSetChunk_State0_stateItem8_ElementIndex=1,
    stateSetChunk_State0_stateItem8_ElementValue="1200",
    stateSetChunk_State0_stateItem8_ElementValueType="System.String",
    stateSetChunk_State0_stateItem9_ElementIndex=1,
    stateSetChunk_State0_stateItem9_ElementValue="100"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)  # -> SavedStates, SavedStateNames
move_4 = Move(Geometry=divide.Points, Motion=flip_3)  # -> Geometry, Transform
move_5 = Move(Geometry=divide_2.Points, Motion=flip_3)  # -> Geometry, Transform
multiplication_5 = Multiplication(A=vec_2, B=division_3)
move_6 = Move(Geometry=extr, Motion=multiplication_4)  # -> Geometry, Transform
childwin = MakeChildWindow(ParentWindow=launchwin, ChildWindow=launchwin_2)
merge_9 = Merge(Data1=label_7, Data2=flatten(stack_6), Data3=button_3)  # -> flatten(Result)
adjustpos_4 = AdjustElementPositioning(ElementsToAdjust=textbox_6, AbsolutePositioning=False, Width=100)
adjustpos_5 = AdjustElementPositioning(ElementsToAdjust=[textbox_9, textbox_8, textbox_7, textbox_10], AbsolutePositioning=False, Width=80)
pline = PolyLine(Vertices=move_5.Geometry, Closed=False)
pline_2 = PolyLine(Vertices=move_4.Geometry, Closed=False)
Z_5 = UnitZ(Factor=Slider(1.7, range=0..2))
winprops = SetWindowProperties(Window=launchwin_2, ShowTitleBar=True, ScaleFactor=1)
pt_2 = Point(pt)
move_7 = Move(Geometry=move_6.Geometry, Motion=multiplication_5)  # -> Geometry, Transform
restore = RestoreElementStates(Restore=values_7.Values, SavedStates=savestates_2.SavedStates, StateNameToRestore="State")
join = JoinCurves(Curves=[cull_i, pline, pline_2], Preserve=False)  # -> simplify(Curves)
move_8 = Move(Geometry=move_6.Geometry, Motion=Z_5)  # -> Geometry, Transform
addelems = AddElements(Window=launchwin_2, Elements=flatten(merge_9), DoVLChecking=True)  # -> AddedElements, ElementNames
crv_2 = Curve(reparameterize(spiral))
series_5 = Series(Start=Slider(0.2, range=0..1), Step=Slider(0.36, range=0..1), Count=Slider(4, range=0..10))
concat_4 = Concatenate(
    FragmentA=values_15.Values,
    FragmentB=" (Nozzle:",
    FragmentD=values_13.Values,
    FragmentE=" Bed:",
    FragmentF=values_12.Values,
    FragmentG=" Speed:",
    FragmentC=values_14.Values,
    FragmentI=" Flow:",
    FragmentJ=values_16.Values,
    FragmentH=")")
data_4 = Data(flatten(concat_4))
pulldown = CreatePulldownMenu(Label=dcon.Set, ListItems=data_4, SelectedIndex=dup, showLabel=True)
adjustpos_6 = AdjustElementPositioning(ElementsToAdjust=pulldown, AbsolutePositioning=False)
merge_10 = Merge(
    Data1=stack_5,
    Data2=stack_4,
    Data3=button,
    Data4=separator_2,
    Data5=data,
    Data7=separator,
    Data8=button_2,
    Data9=pulldown)  # -> flatten(Result)
values_17 = ValueListener(Elements=pulldown, SomeProperty=True)  # -> Values, Indices
addelems_2 = AddElements(Window=launchwin, Elements=flatten(merge_10), DoVLChecking=True)  # -> AddedElements, ElementNames
panel_15 = Panel(values_17.Indices)
fpatch = FragmentPatch(Boundary=join)
flatten_2 = FlattenTree(Tree=fpatch, Path="{0}")
move_9 = Move(Geometry=flatten_2, Motion=Z_3)  # -> Geometry, Transform
dispatch_2 = Dispatch(List=move_9.Geometry, DispatchPattern=c_script_4.A)  # -> ListA, ListB
rot3d = Rotate3D(Geometry=dispatch_2.ListA, Angle=pi, Center=dispatch.ListA, Axis=deplane.YAxis)  # -> Geometry, Transform
rot3d_2 = Rotate3D(Geometry=dispatch_2.ListB, Angle=pi_3, Center=deplane_2.Origin, Axis=Vector(0, 0, 1))  # -> Geometry, Transform
rot3d_3 = Rotate3D(Geometry=rot3d_2.Geometry, Angle=neg_4, Center=dispatch.ListB, Axis=deplane_2.YAxis)  # -> Geometry, Transform
weave_2 = Weave(Pattern=c_script_4.A, Stream0=rot3d_3.Geometry, Stream1=rot3d.Geometry, NullGaps=False)
split_3 = SplitWithBreps(Curve=merge_7, Brep=weave_2)  # -> simplify(Curve), simplify(Points)
filter_2 = StreamFilter(Gate=values_9.Values, Stream1=split_3.Curve)
shift_paths = ShiftPaths(data=filter_2)
c_script_5 = CSharpScript(x=shift_paths)  # -> out, A; inputs x: tree of Curve
# ---------- c_script_5: C# ----------
    DataTree<Curve> output = new DataTree<Curve>();
    for(int i = 0; i < x.BranchCount; i++){
      List<Curve> crvs = x.Branch(i);

      int num = crvs.Count / 2;

      for(int j = 0; j < num; j++){
        List<Curve> joinCrv = new List<Curve>();
        LineCurve l1 = new LineCurve(crvs[j].PointAtStart, crvs[j + num].PointAtStart);
        LineCurve l2 = new LineCurve(crvs[j].PointAtEnd, crvs[j + num].PointAtEnd);

        joinCrv.Add(crvs[j]);
        joinCrv.Add(crvs[j + num]);
        joinCrv.Add(l1);
        joinCrv.Add(l2);

        Curve[] ccc = Curve.JoinCurves(joinCrv);
        Print("" + ccc.Length);
        output.Add(ccc[0], new GH_Path(i));
      }

      A = output;


    }
# ---------- end c_script_5 ----------
crv_3 = Curve(c_script_5.A)
merge_11 = Merge(Data1=values_15.Values, Data2=values_13.Values, Data3=values_12.Values, Data4=values_14.Values, Data5=values_16.Values)
area = Area(Geometry=crv_3)  # -> Area, Centroid
brep = Brep(weave_2)
xy_3 = XYPlane(Origin=Point(0, 0, 0))
rev = ReverseList(List=series_5)
brep_2 = Brep(cap)
panel_16 = Panel(concat_4)
item_5 = ListItem(List=area.Centroid, Index=0, Wrap=True)
preview = CustomPreview(Geometry=brep, Material=ColourSwatch(SwatchColor=RGB(0, 0, 0)))
preview_2 = CustomPreview(
    Geometry=brep_2,
    Material={diffuse=RGB(221, 160, 221), emission=RGB(66, 48, 66), shine=0.5, specular=RGB(255, 255, 255), transparency=0})
item_6 = ListItem(List=rev, Index="2", Wrap=True)
polyoffset = PolylineOffset(Polylines=crv_2, Distance=item_6, Plane=xy_3, Tolerance=0.001, ClosedFillet=1, OpenFillet=1, Miter=2)  # -> Contour, simplify(Holes)
pln = Plane(item_5)
crv_4 = Curve(polyoffset.Contour)
polyoffset_2 = PolylineOffset(Polylines=crv_3, Distance=rev, Plane=pln, Tolerance=0.001, ClosedFillet=0, OpenFillet=0, Miter=2)  # -> Contour, simplify(Holes)
merge_12 = Merge(Data1=crv_2, Data2=crv_4)  # -> flatten(Result)
Z_6 = UnitZ(Factor=Slider(0.16, range=0..1))
split_4 = SplitTree(Data=crv_3, Masks=flatten("{0}"))  # -> Positive, Negative
crv_5 = Curve(polyoffset_2.Holes)
move_10 = Move(Geometry=merge_12, Motion=Z_6)  # -> Geometry, Transform
lng_4 = ListLength(List=split_4.Positive)
c_script_6 = CSharpScript(x=crv_5, y=lng_4)  # -> out, A; inputs x: tree of Curve, y: Int32
# ---------- c_script_6: C# ----------
    DataTree<Curve> output = new DataTree<Curve>();

    for(int i = 0; i < x.BranchCount; i++){
      List<Curve> lc = x.Branch(i);
      Print("" + x.Path(i) + " - " + x.Branch(i).Count);

      if(lc.Count < y){

      }else if(lc.Count > y){

      }else{
        output.AddRange(lc, x.Path(i));
        Print("ADD");
      }
      A = output;
    }
# ---------- end c_script_6 ----------
shift_paths_2 = ShiftPaths(data=c_script_6.A)
area_2 = Area(Geometry=shift_paths_2)  # -> Area, Centroid
split_5 = SplitTree(Data=crv_3, Masks=flatten("{0}"))  # -> Positive, Negative
split_6 = SplitTree(Data=shift_paths_2, Masks=flatten("{0}"))  # -> Positive, Negative
area_3 = Area(Geometry=split_6.Positive)  # -> Area, simplify(graft(Centroid))
area_4 = Area(Geometry=split_5.Positive)  # -> Area, Centroid
area_5 = Area(Geometry=split_5.Positive)  # -> Area, Centroid
lng_5 = ListLength(List=area_5.Centroid)
dist = Distance(PointA=area_5.Centroid, PointB=area_3.Centroid)  # -> simplify(Distance)
series_6 = Series(Start=0, Step=1, Count=lng_5)  # -> simplify(Series)
c_script_7 = CSharpScript(x=area_4.Centroid, y=area_2.Centroid, z=shift_paths_2)  # -> out, A; inputs x: list of Point3d, y: tree of Point3d, z: tree of Curve
# ---------- c_script_7: C# ----------
    DataTree<Curve> output = new DataTree<Curve>();

    for(int i = 0; i < y.BranchCount; i++){
      List<int> order = new List<int>();

      if(i == 0){
        //output.AddRange(num_list, new GH_Path(i));
        continue;
      }

      // ========================

      List<Point3d> points = y.Branch(i);
      List<Curve> curves = z.Branch(i);
      int repeat_num = points.Count / x.Count;

      for(int k = 0; k < repeat_num; k++){
        List<Point3d> sub_points = points.GetRange(k * x.Count, x.Count);

        for(int j = 0; j < x.Count; j++){
          int min_idx = 0;
          double min_len = x[j].DistanceTo(sub_points[0]);

          for(int l = 1; l < sub_points.Count; l++){
            double d = x[j].DistanceTo(sub_points[l]);
            if(d < min_len){
              min_len = d;
              min_idx = l;
            }
          }
          order.Add(min_idx + k * x.Count);
        }

      }

      GH_Path p = new GH_Path(i-1);
      for(int k = 0; k < order.Count; k++){
        output.Add(curves[order[k]], p);

      }




    }
    A = output;
# ---------- end c_script_7 ----------
sort_2 = SortList(Keys=dist, ValuesA=series_6)  # -> Keys, simplify(ValuesA)
item_7 = ListItem(List=sort_2.ValuesA, Index=0, Wrap=True)  # -> flatten(Item)
c_script_8 = CSharpScript(After=c_script_7.A, Order=item_7)  # -> out, Filament; inputs After: tree of Curve, Order: list of Int32
# ---------- c_script_8: C# ----------
    DataTree<Curve> PartOriented = new DataTree<Curve>();

    int num = Order.Count;
    for(int i = 0; i < After.BranchCount; i++){
      List<Curve> crvs_list = After.Branch(i);

      int count = crvs_list.Count / num;
      Print("i:" + i + " c:" + count + " cc:" + crvs_list.Count);

      for(int ii = 0; ii < num; ii++){
        for(int jj = 0; jj < count; jj++){
          GH_Path p = new GH_Path(ii);

          Print("" + p + " " + (ii + jj * num));
          PartOriented.Add(crvs_list[ii + (jj * num)], p);
        }
      }
    }

    Filament = PartOriented;

    //A = PartOriented;
/*
    DataTree<Curve> Output = new DataTree<Curve>();

    for(int i = 0; i < Order.Count; i++){
      GH_Path p = new GH_Path(Order[i]);
      Print("" + i + " to " + Order[i] + " p:" + p);
      Output.AddRange(PartOriented.Branch(i), p);
    }
*/

    //Filament = Output;

    //C = PartOriented.Branch(0);
# ---------- end c_script_8 ----------
crv_6 = Curve(reparameterize(c_script_8.Filament))
crv_cp = CurveClosestPoint(Point=pt_2, Curve=crv_6)  # -> Point, Parameter, Distance
number_slider_8 = Slider(0.1, range=0..0.1)
seam = Seam(Curve=crv_6, Seam=crv_cp.Parameter)
cap_2 = CapHoles(Brep=move_8.Geometry)
fillet = Fillet(Curve=seam, Radius=Slider(0.15, range=0..1))
neg_5 = Negative(Value=Slider(0.25, range=-0.01..1))
topoly = CurveToPolyline(Curve=fillet, ToleranceDistance=number_slider_8, ToleranceAngle=number_slider_8)  # -> Polyline, Segments
neg_6 = Negative(Value=Slider(3.4, range=0..5))
Z_7 = UnitZ(Factor=neg_5)
panel_17 = Panel("""-1
-2""")
Z_8 = UnitZ(Factor=neg_6)
move_11 = Move(Geometry=cap_2, Motion=Z_7)  # -> Geometry, Transform
panel_18 = Panel("""0
-1""")
item_8 = ListItem(List=topoly.Polyline, Index=panel_17, Wrap=True)
item_9 = ListItem(List=topoly.Polyline, Index="0", Wrap=True)
move_12 = Move(Geometry=cap_2, Motion=Z_8)  # -> Geometry, Transform
cull_i_2 = CullIndex(List=topoly.Polyline, Indices=panel_18, Wrap=True)  # -> simplify(List)
item_10 = ListItem(List=topoly.Polyline, Index="-1", Wrap=True)
trim = TrimWithBreps(Curve=item_8, Brep=move_11.Geometry)  # -> simplify(Inside), simplify(Outside)
trim_2 = TrimWithBreps(Curve=item_9, Brep=move_12.Geometry)  # -> simplify(Inside), simplify(Outside)
trim_3 = TrimWithBreps(Curve=item_10, Brep=move_11.Geometry)  # -> simplify(Inside), simplify(Outside)
connect = ConnectCurves(Curves=trim_2.Outside, Continuity=2, Close=True, Bulge=1)
rev_2 = ReverseList(List=trim_2.Inside)
connect_2 = ConnectCurves(Curves=trim.Outside, Continuity=2, Close=True, Bulge=1)  # -> simplify(Curve)
rev_3 = ReverseList(List=trim_3.Inside)
pshift = ShiftPaths(Data=connect_2, Offset=-1)
rev_4 = ReverseList(List=pshift)
merge_13 = Merge(Data1=connect, Data2=cull_i_2, Data3=rev_4)
vec_3 = VectorXYZ(XComponent=0, YComponent=0, ZComponent=0)  # -> Vector, Length
partition = PartitionList(List=flatten(rev_2), Size="2")  # -> simplify(Chunks)
partition_2 = PartitionList(List=flatten(rev_3), Size="2")  # -> simplify(Chunks)
crv_cp_2 = CurveClosestPoint(Point=vec_3.Vector, Curve=merge_13)  # -> Point, Parameter, Distance
end = EndPoints(Curve=partition_2)  # -> Start, End
end_2 = EndPoints(Curve=partition)  # -> Start, End
seam_2 = Seam(Curve=merge_13, Seam=crv_cp_2.Parameter)
pt_3 = Point(flatten(end.Start))
merge_14 = Merge(Data1=end_2.Start, Data2=end_2.End)
pt_4 = Point(flatten(end_2.Start))
merge_15 = Merge(Data1=end.Start, Data2=end.End)
data_5 = Data(flatten(values_17.Indices))
data_6 = Data(merge_11)
item_11 = ListItem(List=pt_3, Index=0, Wrap=True)
item_12 = ListItem(List=pt_4, Index=0, Wrap=True)
pdecon = Deconstruct(Point=item_11)  # -> XComponent, YComponent, ZComponent
pdecon_2 = Deconstruct(Point=item_12)  # -> XComponent, YComponent, ZComponent
hull = ConvexHull(Points=merge_15, Plane=PlaneXY(0, 0, 0))  # -> Hull, HullZ, Indices
subtraction = Subtraction(A=pdecon.ZComponent, B=Slider(0, range=0..1))
hull_2 = ConvexHull(Points=merge_14, Plane=PlaneXY(0, 0, 0))  # -> Hull, HullZ, Indices
Z_9 = UnitZ(Factor=pdecon_2.ZComponent)
Z_10 = UnitZ(Factor=subtraction)
move_13 = Move(Geometry=hull.Hull, Motion=Z_10)  # -> flatten(Geometry), Transform
move_14 = Move(Geometry=hull_2.Hull, Motion=Z_9)  # -> flatten(Geometry), Transform
pipe = Pipe(Curve=[move_13.Geometry, move_14.Geometry], Radius=Slider(0.1, range=0..1), Caps=0)
explode_2 = Explode(Curve=move_13.Geometry, Recursive=True)  # -> Segments, Vertices
len_2 = Length(Curve=explode_2.Segments)
panel_19 = Panel("""2
3""")
sort_3 = SortList(Keys=len_2, ValuesA=explode_2.Segments)  # -> Keys, ValuesA
item_13 = ListItem(List=sort_3.ValuesA, Index=panel_19, Wrap=True)  # -> simplify(Item)
item_14 = ListItem(List=item_13, Index=1, Wrap=True)
item_15 = ListItem(List=item_13, Index=0, Wrap=True)
flip_4 = FlipCurve(Curve=item_14)  # -> Curve, Flag
number_slider_9 = Slider(10, range=0..20)
divide_3 = DivideCurve(Curve=item_15, Count=number_slider_9, Kinks=False)  # -> Points, Tangents, Parameters
divide_4 = DivideCurve(Curve=flip_4.Curve, Count=number_slider_9, Kinks=False)  # -> Points, Tangents, Parameters
weave_3 = Weave(Pattern=[0, 1], Stream0=divide_3.Points, Stream1=divide_4.Points, NullGaps=False)
weave_4 = Weave(Pattern=[0, 1], Stream0=divide_4.Points, Stream1=divide_3.Points, NullGaps=False)
neg_7 = Negative(Value=Slider(0.16, range=0..1))
Z_11 = UnitZ(Factor=neg_7)
pline_3 = PolyLine(Vertices=weave_4, Closed=False)
pline_4 = PolyLine(Vertices=weave_3, Closed=False)
output_directory = Panel("C:\Gcode\")
move_15 = Move(Geometry=pline_3, Motion=Z_11)  # -> Geometry, Transform
flip_5 = FlipCurve(Curve=move_15.Geometry)  # -> Curve, Flag
merge_16 = Merge(Data1=flip_5.Curve, Data2=pline_4)  # -> simplify(flatten(Result))
data_7 = Data(merge_16)
c_script_9 = CSharpScript(
    MaterialSettings=data_6,
    SelectedMaterial=data_5,
    Base=move_10.Geometry,
    Filament=seam_2,
    ColorNum=data_2,
    BaseJoint=move_14.Geometry,
    Joint=data_7,
    FilePath=output_directory)  # -> out, A; inputs Apply: Boolean, MaterialSettings: tree, SelectedMaterial: list of Int32, Base: list of Curve, Filament: tree of Curve, ColorNum: list of Int32, BaseJoint: list of Curve, Joint: list of Curve, FilePath: String
# ---------- c_script_9: C# usings ----------
using System.Text;
using System.IO;
# ---------- c_script_9: C# ----------
    if(!Apply){
      //return;
    }

    _LayerHeight = 0.16;
    _NozzleWidth = 0.4;
    _RetAmount = 4.0;
    _RetSpeed = 2700;
    _PrintingSpeed = 1200;

    StringBuilder sb = new StringBuilder();

    MaterialSetting[] matSet = new MaterialSetting[MaterialSettings.BranchCount];

    for(int i = 0; i < MaterialSettings.BranchCount;i++){
      List<Object> m = MaterialSettings.Branch(i);
      matSet[i] = new MaterialSetting(m);
    }


    sb.Append("G29\n");

    sb.Append("M140 S" + matSet[SelectedMaterial[0]].bed_temperature + "\n");
    sb.Append("M190 S" + matSet[SelectedMaterial[0]].bed_temperature + "\n");

    sb.Append("M104 S" + matSet[SelectedMaterial[0]].nozzle_temperature + "\n");
    sb.Append("M109 S" + matSet[SelectedMaterial[0]].nozzle_temperature + "\n");



    sb.Append("G28\n");
    sb.Append("M83\n");
    sb.Append("G90\n");
    sb.Append("G1 F300 Z0.4\n");
    sb.Append("G1 X50 E10 F300\n");


    // ============================================================================
    for(int i = 0; i < _Base.Count; i++){
      Curve crv = _Base[i];

      List<Point3d> points = new List<Point3d>();

      // Polyline
      double tMin = crv.Domain.Min;
      double tMax = crv.Domain.Max;
      double t = 0.0;

      // Polyline　to points
      while (crv.GetNextDiscontinuity(Continuity.C1_locus_continuous, tMin, tMax, out t)){
        points.Add(crv.PointAt(t));
        tMin = t;
      }

      if(points.Count != 0){
        for(int k = 0; k < points.Count; k++){
          if(k == 0){
            sb.Append(makeRetraction(_RetAmount, _RetSpeed, -1));
            sb.Append("G1 F300 Z" + (points[0].Z) + "\n");
            sb.Append(makeGcode(points[0]));
            sb.Append(makeRetraction(_RetAmount, _RetSpeed, 1));
          }else{
            sb.Append(makeGcode(points[k - 1], points[k], 0.1));
          }
        }
        sb.Append(makeGcode(points[points.Count - 1], points[0], 0.1));
      }
    }

    // BaseJoint =====================================================
    for(int i = 0; i < BaseJoint.Count; i++){
      Curve crv = BaseJoint[i];
      if(crv == null){continue;}
      List<Point3d> points = new List<Point3d>();

      // Polyline
      double tMin = crv.Domain.Min;
      double tMax = crv.Domain.Max;
      double t = 0.0;

      while (crv.GetNextDiscontinuity(Continuity.C1_locus_continuous, tMin, tMax, out t)){
        points.Add(crv.PointAt(t));
        tMin = t;
      }

      sb.Append(makeRetraction(_RetAmount, _RetSpeed, -1));
      sb.Append("G1 F300 Z2\n");

      if(points.Count != 0){
        for(int k = 0; k < points.Count; k++){
          if(k == 0){
            sb.Append(makeGcode(points[0]));
            sb.Append("G1 F300 Z" + (points[0].Z) + "\n");
            sb.Append(makeRetraction(_RetAmount, _RetSpeed, 1));

          }else{
            sb.Append(makeGcode(points[k - 1], points[k], 0, _PrintingSpeed / 2));
          }
        }
        sb.Append(makeGcode(points[points.Count - 1], points[0], 0, _PrintingSpeed / 2));

      }
    }


    // ============================================================================
    int ColorMax = -1;
    for(int i = 0; i < ColorNum.Count; i++){
      if(ColorNum[i] > ColorMax){
        ColorMax = ColorNum[i];
      }
    }
    Print("" + ColorMax);

    // ============================================================================
    DataTree<Curve> PartOriented = Filament;
    ColorNum.Add(0);

    // ============================================================================
    for(int c = 0; c <= ColorMax; c++){

      bool flag = false;
      for(int i = 0; i < ColorNum.Count; i++){
        if(c == ColorNum[i]){ flag = true; }
      }
      if(!flag){
        continue;
      }
      MaterialSetting mSet = matSet[SelectedMaterial[c]];


      for(int i = 0; i < ColorNum.Count; i++){
        Print("i: " + i + " col_i: " + ColorNum[i] + " c:" + c);
        if(c != ColorNum[i]){ continue; }


        //Print("" + matSet[SelectedMaterial[i]].name);
        Print("" + mSet.name);

        sb.Append("; ========== " + i + " ========== \n");
        sb.Append("; ========== " + mSet.name + " ========== \n");

        List<Curve> crvs = PartOriented.Branch(i);
        Print(" *** " + crvs.Count);
        sb.Append(makeRetraction(_RetAmount, _RetSpeed, -1));

        for(int j = 0; j < crvs.Count; j++){

          Curve crv = crvs[j];
          if(crv == null){continue;}
          List<Point3d> points = new List<Point3d>();

          // Polyline
          double tMin = crv.Domain.Min;
          double tMax = crv.Domain.Max;
          double t = 0.0;

          while (crv.GetNextDiscontinuity(Continuity.C1_locus_continuous, tMin, tMax, out t)){
            points.Add(crv.PointAt(t));
            tMin = t;
          }

          if(points.Count != 0){
            for(int k = 0; k < points.Count; k++){
              if(k == 0){
                if(j == 0){
                  sb.Append("G1 F300 Z3\n");
                }
                sb.Append(makeGcode(points[0]));
                sb.Append("G1 F300 Z" + (points[0].Z) + "\n");
                if(j == 0){
                  sb.Append(makeRetraction(_RetAmount, _RetSpeed, 1));
                }

              }else{
                sb.Append(makeGcode(points[k - 1], points[k], true, mSet.speed, mSet.flow));
              }
            }
            sb.Append(makeGcode(points[points.Count - 1], points[0], true, mSet.speed, mSet.flow));

          }
        }

      }

      // ======
      sb.Append(makeRetraction(_RetAmount, _RetSpeed, -1));
      sb.Append("; ========== CHANGE FILAMENT ========== \n");

      sb.Append("G1 F300 Z2\n");
      sb.Append("G0 F1200 X10 Y" + (5 + (2 * c)) + "\n");
      sb.Append("G1 F300 Z25\n");

      sb.Append("M300 S300 P100\n");

      sb.Append("G1 E-300 F1000\n");

      sb.Append(";\n");
      sb.Append("; ========== CHANGE TEMPERATURE AND PAUSE ========== \n");
      sb.Append("M104 S" + mSet.nozzle_temperature + " ; Set nozzle temperature without wait\n");
      sb.Append("M140 S" + mSet.bed_temperature + " ; Set bed temperature without wait\n");
      sb.Append(";\n");

      if(c != ColorMax){
        sb.Append("M0 Next material: " + matSet[SelectedMaterial[c + 1]].name + "\n");
      }else{
        sb.Append("M0 Next material is for joint \n");
      }

      sb.Append(";\n");
      sb.Append("M109 S" + mSet.nozzle_temperature + " ; Set nozzle temp and WAIT\n");
      sb.Append("M190 S" + mSet.bed_temperature + " ; Set bed temp and WAIT\n");
      sb.Append(";\n");

      sb.Append(makeRetraction(50, 100, 1));
      sb.Append("G4 P3000\n");

      sb.Append("G92 E0\n");

      sb.Append("G1 F300 Z0.5\n");
      sb.Append("G1 X80 E20 F100\n");
      sb.Append("G1 F300 Z2\n");
      sb.Append("G92 E0\n");
      //}
    }

    // Joint =====================================================
    for(int i = 0; i < Joint.Count; i++){
      sb.Append("; ========== JOINT ========== \n");
      Curve crv = Joint[i];
      if(crv == null){continue;}
      List<Point3d> points = new List<Point3d>();

      // Polyline
      double tMin = crv.Domain.Min;
      double tMax = crv.Domain.Max;
      double t = 0.0;

      while (crv.GetNextDiscontinuity(Continuity.C1_locus_continuous, tMin, tMax, out t)){
        points.Add(crv.PointAt(t));
        tMin = t;
      }

      sb.Append(makeRetraction(_RetAmount, _RetSpeed, -1));
      sb.Append("G1 F300 Z2\n");

      if(points.Count != 0){
        for(int k = 0; k < points.Count; k++){
          if(k == 0){
            sb.Append(makeGcode(points[0]));
            sb.Append("G1 F300 Z" + (points[0].Z) + "\n");
            sb.Append(makeRetraction(_RetAmount, _RetSpeed, 1));

          }else{
            sb.Append(makeGcode(points[k - 1], points[k], 0, _PrintingSpeed / 2));
          }
        }
      }
    }




    sb.Append(makeRetraction(_RetAmount * 5, _RetSpeed, -1));

    sb.Append("G1 F300 Z15\n");
    sb.Append("G0 F1200 X10 Y10\n");

    sb.Append("M84\n");

    string filename = "Filament_" + DateTime.Now.ToString("yyyyMMdd_HHmmss") + ".gcode";
    WriteFile(sb.ToString(), FilePath + filename);
# ---------- c_script_9: C# additional code ----------
  double _LayerHeight;
  double _NozzleWidth;
  int _PrintingSpeed;
  double _RetAmount;
  int _RetSpeed;

  // save Gcode file
  void WriteFile(String str, String path){
    StreamWriter sw = new StreamWriter(path, false, Encoding.GetEncoding("UTF-8"));
    sw.Write(str);
    sw.Close();
  }

  // making a retraction command according to the direction (sign)
  String makeRetraction(double amount, int speed, double sign){
    string mes = "";
    if(sign == -1){
      mes = " ; Retraction";
    }else{
      mes = " ; Extraction";
    }
    return "G1 F" + speed + " E" + (sign * amount) + mes + "\n";
  }

  String makeGcode(Point3d fr, Point3d to)
  {
    double len = (to - fr).Length;
    double numerator = (_NozzleWidth * len * _LayerHeight);
    double denominator = (1.75 / 2) * (1.75 / 2) * Math.PI;

    double e = numerator / denominator;

    return "G1 F1200 X" + to.X.ToString("F2") + " Y" + to.Y.ToString("F2") + " E" + e.ToString("F8") + "\n";
  }

  String makeGcode(Point3d fr, Point3d to, double height)
  {
    double len = (to - fr).Length;
    double numerator = (_NozzleWidth * len * height);
    double denominator = (1.75 / 2) * (1.75 / 2) * Math.PI;

    double e = numerator / denominator;

    return "G1 F1200 X" + to.X.ToString("F2") + " Y" + to.Y.ToString("F2") + " E" + e.ToString("F8") + "\n";
  }

  String makeGcode(Point3d fr, Point3d to, double height, int speed)
  {
    double len = (to - fr).Length;
    double numerator = (_NozzleWidth * len * _LayerHeight);
    double denominator = (1.75 / 2) * (1.75 / 2) * Math.PI;

    double e = numerator / denominator;

    return "G1 F" + speed + " X" + to.X.ToString("F2") + " Y" + to.Y.ToString("F2") + " E" + e.ToString("F8") + "\n";
  }

  String makeGcode(Point3d fr, Point3d to, bool dummy, int speed, int flow)
  {
    double len = (to - fr).Length;
    double numerator = (_NozzleWidth * len * _LayerHeight);
    double denominator = (1.75 / 2) * (1.75 / 2) * Math.PI;

    double e = numerator / denominator;
    e = (e * flow) / 100.0;

    return "G1 F" + speed + " X" + to.X.ToString("F2") + " Y" + to.Y.ToString("F2") + " E" + e.ToString("F8") + " ; flow:" + flow + "%\n";
  }

  String makeGcode(Point3d to){
    return "G0 F9000 X" + to.X.ToString("F2") + " Y" + to.Y.ToString("F2") + "\n";
  }



  public class MaterialSetting{
    public string name;
    public int nozzle_temperature;
    public int bed_temperature;
    public int speed;
    public int flow;

    public MaterialSetting(List<Object> mat){
      this.name = (string) mat[0];
      this.nozzle_temperature = Convert.ToInt32(mat[1]);
      this.bed_temperature = Convert.ToInt32(mat[2]);
      this.speed = Convert.ToInt32(mat[3]);
      this.flow = Convert.ToInt32(mat[4]);


    }

  }
# ---------- end c_script_9 ----------
panel_20 = Panel(c_script_9.out)

# ==== cluster Spiral
axisstart = ClusterInput()
axisdir = ClusterInput()
radiuspoint = ClusterInput()
pitch = ClusterInput()
turncount = ClusterInput()
radius0 = ClusterInput()
radius1 = ClusterInput()
c_script = CSharpScript(
    axisStart=axisstart,
    axisDir=axisdir,
    radiusPoint=radiuspoint,
    pitch=pitch,
    turnCount=turncount,
    radius0=radius0,
    radius1=radius1)  # -> out, A; inputs axisStart: Point3d, axisDir: Vector3d, radiusPoint: Point3d, pitch: Double, turnCount: Double, radius0: Double, radius1: Double
# ---------- c_script: C# ----------
    A = NurbsCurve.CreateSpiral(
      axisStart,
      axisDir,
      radiusPoint,
      pitch,
      turnCount,
      radius0,
      radius1
      );
# ---------- end c_script ----------
A = ClusterOutput(c_script.A)

# ==== cluster ShiftPaths: Shift -1 in all data tree paths
data = ClusterInput()  # Data to modify
data_2 = Data(simplify(data))
path_mapper = PathMapper(
    data_2,
    source=["{A}", "{A;B}", "{A;B;C}", "{A;B;C;D}", "{A;B;C;D;E}", "{A;B;C;D;E;F}", "{A;B;C;D;E;F;G}", "{A;B;C;D;E;F;G;H}", "{A;B;C;D;E;F;G;H;I}", "{A;B;C;D;E;F;G;H;I;K}"],
    target=["{0}", "{A}", "{A;B}", "{A;B;C}", "{A;B;C;D}", "{A;B;C;D;E}", "{A;B;C;D;E;F}", "{A;B;C;D;E;F;G}", "{A;B;C;D;E;F;G;H}", "{A;B;C;D;E;F;G;H;I}"])
data_3 = Data(path_mapper)
data_4 = ClusterOutput(data_3)  # Shifted data
